# Grasshopper definition 1D.gh (Grasshopper 1.0.7)

# One-Dimensional Cellular Automata
trigger = Trigger(Interval=100, TimerInterval=100, Target=panel)
panel = Panel("1")
rec = DataRecorder(panel, DataLimit=100, RecordData=False)
ma = MassAddition(Input=rec)  # -> Result, PartialResults
python = GhPythonScript(NumMax=Slider(30, range=1..500), SetupNum=Slider(1, range=0..10), TimeStep=ma.Result, Toggle=Toggle(False))  # -> out, Pts, frame; inputs NumMax: Int32, SetupNum: Int32, TimeStep: Int32, Toggle: Boolean
# ---------- python: Python ----------
__author__ = "yh496"
__version__ = "2022.01.22"

import rhinoscriptsyntax as rs
import math
import random
import time

def Judge(lista, listb):
    
    # 对于首位点的状态判断
    if lista.values()[0] == lista.values()[1] and lista.values()[0] == 0:
        listb[0] = 0
    elif lista.values()[0] == lista.values()[1] and lista.values()[0] == 1:
        listb[0] = 0
    else:
        listb[0] = 1
    
    #对于末尾点的状态判断
    if lista.values()[-1] == lista.values()[-2] and lista.values()[-1] == 0:
        listb[len(listb.keys())-1] = 0
    elif lista.values()[-1] == lista.values()[-2] and lista.values()[-1] == 1:
        listb[len(listb.keys())-1] = 0
    else:
        listb[len(listb.keys())-1] = 1
    
    # 对于中间点的状态判断
    i = 1
    for i in range(1, len(lista.keys())-1):
        if lista.values()[i] == lista.values()[i-1] and lista.values()[i] == lista.values()[i+1] and lista.values()[i] == 0:
            listb[i] = 0
        elif lista.values()[i] == lista.values()[i-1] and lista.values()[i] == lista.values()[i+1] and lista.values()[i] == 1:
            listb[i] = 0
        else:
            listb[i] = 1

def AddPt(list):
    
    # 生成点
    for i in range(NumMax):
        if list[i]:
            Pts.append(rs.AddPoint(i, 0, 0))

if __name__ == '__main__':
    
    # 生成初始value为0的dict
    ini = dict.fromkeys(range(NumMax), 0)
    
    # 生成初始点，随机选取SetupNum个点
    for i in random.sample(ini.keys(), SetupNum):
        ini[i] = 1
    
    # 初始化结果dict
    res = ini.copy()
    
    # 生成框架，方便可视化
    plane = rs.WorldXYPlane()
    frame = rs.AddRectangle(plane, NumMax, 1.0)
    
    Pts = []
    AddPt(res)
    
    # 工作流程，TimeStep控制迭代次数
    count = 0
    if Toggle:
        while count < TimeStep:
            
            Pts = []
            Judge(ini, res)
            AddPt(res)
            
            ini.update(res)
            count += 1
# ---------- end python ----------
cell = Slider(1, range=0..1)
rectangle = Rectangle(Plane=python.Pts, XSize=cell, YSize=cell, Radius=0)  # -> Rectangle, Length
boundary = BoundarySurfaces(Edges=rectangle.Rectangle)
crv = Curve(python.frame)
