# Grasshopper definition 2D.gh (Grasshopper 1.0.7)

# Two-Dimensional Cellular Automata
trigger = Trigger(Interval=100, TimerInterval=100, Target=panel)
panel = Panel("1")
rec = DataRecorder(panel, DataLimit=100, RecordData=False)
ma = MassAddition(Input=rec)  # -> Result, PartialResults
cell = Slider(1, range=0..1)
python = GhPythonScript(NumMax=Slider(40, range=1..100), SetupNum=Slider(60, range=0..100), TimeStep=ma.Result, Toggle=Toggle(False))  # -> out, Pts, frame; inputs NumMax: Int32, SetupNum: Int32, TimeStep: Int32, Toggle: Boolean
# ---------- python: Python ----------
__author__ = "yh496"
__version__ = "2022.01.23"

import rhinoscriptsyntax as rs
import random
import copy

class Pt(object):
    
    def __init__(self, x, y, state):
        
        # 点坐标(x, y)，state(0, 1)判定        
        self.x = x
        self.y = y
        self.state = int(state)

def SetupMatrix(Number):
    
    # 初始化长宽 = Number的点阵
    ino = []
    for i in range(Number):
        for j in range(Number):
            ino.append('Pt%d%d' %(i, j))
    
    split = lambda ino, Number: [ino[i:i + Number] for i in range(0, len(ino), Number)]
    
    return split(ino, Number)

def Randomchoice(Number):
    
    # 拆分嵌套列表为tmp，然后随机选择Number个随机数使state = 1
    tmp = []
    for i in range(1, FrameLen):
        for j in range(1, FrameLen):
                tmp.append(ini[i][j])
    
    s = []
    i= 0
    while i  < Number:
        temp = random.choice(tmp)
        if temp not in s:
            s.append(temp)
            temp.state = 1
            i += 1

def AddPt(lista):
    
    # 生成state == 1的点
    listb = []
    for i in range(NumMax):
        for j in range(NumMax):
            if lista[i][j].state == 1:
                listb.append(rs.AddPoint(lista[i][j].x, lista[i][j].y, 0))
    return listb

def Judge(lista, listb):
    
    # 设定
    M = [1, 2, 4]
    N = [3, 7]
    '''
    Life Rule: 
    if self.state == 1：
        if num.surrounding.state = 1 in M:
            self.state = 1
        else self.state = 0
    if self.state == 0:
        if num.surrounding.state = 1 in N:
            self.state = 1
        else self.state = 0
    '''    
    
    for i in range(1, FrameLen):
        for j in range(1, FrameLen):
            
            sum = 0
            
            # 选取（i, j）周边的子点阵
            slice = lambda row1, row2, col1, col2, lst: [lst[x][col1:col2] for x in range(row1, row2)]
            templst = slice(i-1, i+2, j-1, j+2, ini)
            for m in range(3):
                for n in range(3):
                    sum += templst[m][n].state
            
            if lista[i][j].state == 1:
                sum -= 1
                if sum in M:
                    listb[i][j].state = 1
                else:
                    listb[i][j].state = 0
            
            elif lista[i][j].state == 0:
                if sum in N:
                    listb[i][j].state = 1
                else:
                    listb[i][j].state = 0

if __name__ == '__main__':
    
    # 生成框架，方便可视化
    plane = rs.WorldXYPlane()
    frame = rs.AddRectangle(plane, NumMax, NumMax)
    
    # 简化，边界不参与
    FrameLen = NumMax - 1
    
    # 初始化点阵
    ini = SetupMatrix(NumMax)
    
    for i in range(NumMax):
        for j in range(NumMax):
            ini[i][j] = Pt(x = i,y = j,state = 0)
    
    # 生成随机初始点，令Pt.state = 1
    Randomchoice(SetupNum)
    Pts = AddPt(ini)
    
    # 初始化结果
    res = copy.deepcopy(ini)
    
    # 工作流程
    step = 0
    if Toggle:
        while step < TimeStep:
            
            Judge(ini, res)
            Pts = AddPt(res)
            
            ini = copy.copy(res)
            step += 1
# ---------- end python ----------
rectangle = Rectangle(Plane=python.Pts, XSize=cell, YSize=cell, Radius=0)  # -> Rectangle, Length
boundary = BoundarySurfaces(Edges=rectangle.Rectangle)
crv = Curve(python.frame)
