# Grasshopper definition 3D.gh (Grasshopper 1.0.7)
# plug-ins: Kangaroo2 Components

trigger = Trigger(Interval=100, TimerInterval=100, Target=panel)
panel = Panel("1")
rec = DataRecorder(panel, DataLimit=100, RecordData=False)
ma = MassAddition(Input=rec)  # -> Result, PartialResults
setupnum = Slider(40, range=0..100)
number_slider = Slider(80, range=0..100)
# Three-Dimensional Cellular Automata
number_slider_2 = Slider(10, range=0..100)
cell = Slider(1, range=0..1)
python = GhPythonScript(
    len=number_slider_2,
    wid=Slider(10, range=0..100),
    heg=number_slider,
    SetupNum=setupnum,
    TimeStep=ma.Result,
    Toggle=Toggle(False))  # -> out, Pts, frame; inputs len: Int32, wid: Int32, heg: Int32, SetupNum: Int32, TimeStep: Int32, Toggle: Boolean
# ---------- python: Python ----------
__author__ = "yh496"
__version__ = "2022.01.25"

import rhinoscriptsyntax as rs
import random
import copy

class Pt(object):
    
    def __init__(self, x, y, z, state):
        
        # 点坐标(x, y, z)，state(0, 1)判定        
        self.x = x
        self.y = y
        self.z = z
        self.state = int(state)

def Setup3dmatrix(length, width, height):
    
    # 初始化长length，宽width，高height的点阵
    ino = [[['Pt(%d, %d, %d)'%(k, j, i) for i in range(height)] for j in range(width)] for k in range(length)]
    for i in range(length):
        for j in range(width):
            for k in range(height):
                ino[i][j][k] = Pt(x = i,y = j, z = k, state = 0)
    
    return ino

def Randomchoice(Number):
    
    # 拆分嵌套列表为tmp，然后随机选择Number个随机数使state = 1
    tmp = []
    for i in range(1, FrameLen):
        for j in range(1, FrameWid):
            for k in range(1, FrameHeg):
                tmp.append(ini[i][j][k])
    
    s = []
    i= 0
    while i  < Number:
        temp = random.choice(tmp)
        if temp not in s:
            s.append(temp)
            temp.state = 1
            i += 1

def AddPt(lista):
    
    # 生成state == 1的点
    listb = []
    for i in range(len):
        for j in range(wid):
            for k in range(heg):
                if lista[i][j][k].state == 1:
                    listb.append(rs.AddPoint(lista[i][j][k].x, lista[i][j][k].y, lista[i][j][k].z))
    return listb

def Judge(lista, listb):
    
    # 设定
    M = [1, 2, 4]
    N = [3, 7]
    '''
    Life Rule: 
    if self.state == 1：
        if num.surrounding.state = 1 in M:
            self.state = 1
        else self.state = 0
    if self.state == 0:
        if num.surrounding.state = 1 in N:
            self.state = 1
        else self.state = 0
    '''    
    
    for i in range(1, FrameLen):
        for j in range(1, FrameWid):
            for k in range(1, FrameHeg):
                sum = 0
                tempheg = []
                # 选取（i, j, k）周边的子点阵
                slice = lambda row1, row2, col1, col2, lst: [lst[x][col1:col2] for x in range(row1, row2)]
                
                for m in range(i-1, i+2):
                    temp = slice(j-1, j+2, k-1, k+2, ini[m])
                    tempheg.append(temp)
                for m in range(3):
                    for n in range(3):
                        for o in range(3):
                            sum += tempheg[m][n][o].state
                
                if lista[i][j][k].state == 1:
                    sum -= 1
                    if sum in M:
                        listb[i][j][k].state = 1
                    else:
                        listb[i][j][k].state = 0
                
                elif lista[i][j][k].state == 0:
                    if sum in N:
                        listb[i][j][k].state = 1
                    else:
                        listb[i][j][k].state = 0

if __name__ == '__main__':
    
    ini = Setup3dmatrix(len, wid, heg)
    
    # 简化，边界不参与
    FrameLen = len - 1
    FrameWid = wid - 1
    FrameHeg = heg - 1
    
    # 生成框架，方便可视化
    plane = rs.WorldXYPlane()
    frame = rs.AddRectangle(plane, len, wid)
    
    # 初始化
    Randomchoice(SetupNum)
    Pts = AddPt(ini)
    
    res = copy.deepcopy(ini)    
    
    # 工作流程
    step = 0
    if Toggle:
        while step < TimeStep:
            
            Judge(ini, res)
            Pts = AddPt(res)
            
            ini = copy.copy(res)
            step += 1
# ---------- end python ----------
rectangle = Rectangle(Plane=python.Pts, XSize=cell, YSize=cell, Radius=0)  # -> Rectangle, Length
boxrec = BoxRectangle(Rectangle=python.frame, Height=number_slider)
wires = BrepWireframe(Brep=boxrec, Density=-1)
boxrec_2 = BoxRectangle(Rectangle=rectangle.Rectangle, Height=cell)
crv = Curve(wires)
wires_2 = BrepWireframe(Brep=boxrec_2, Density=-1)  # -> flatten(Wireframe)
mp = MultiPipe(
    Curves=wires_2,
    NodeSize=Slider(0.1, range=0..1),
    EndOffset=Slider(0, range=0..1),
    StrutSize=Slider(1, range=0..1),
    Segment=0,
    KinkAngle=Slider(0.6, range=0..1),
    CubeFit=Slider(1, range=0..1),
    Caps="1")  # disabled
